# Grasshopper definition 251219_Urban_Noise_Sim.gh (Grasshopper 1.0.8)
# plug-ins: Pufferfish, PTComponentLibrary, Bifocals, eleFront

python_3_script = Python3Script(Find=Toggle(True))  # -> out
# ---------- python_3_script: Python ----------
import rhinoscriptsyntax as rs
import Grasshopper as gh

# Define 'Find' to execute the code block
Find = True

if Find:
    asms = {}
    
    # Loop through all objects in the Grasshopper document
    for obj in ghenv.Component.OnPingDocument().Objects:
        asm = gh.Instances.ComponentServer.FindAssemblyByObject(obj.ComponentGuid)
        
        # Check if assembly is found and is not a core library
        if asm is not None and not asm.IsCoreLibrary:
            # Store the assembly name and version
            asms[asm.Name] = asm.Version
    
    # Display each assembly name with its version
    for name, version in asms.items():
        print(f"Plugin: {name}, Version: {version}")
    
    # Assign assemblies to 'Dep'
    Dep = asms
# ---------- end python_3_script ----------
external_plugins = Panel(python_3_script)

# ----
# Simulation parameters
model_units_for_correct_scaling = ValueList({"Millimeters": 0, "Centimeters": 1, "Meters": 2}, selected="Meters")
distance_between_noise_sources = Panel("5")
number_of_rays_from_one_source = Panel("500")
average_result_with_near_points = Panel("8")
grid_size = Panel("4")
run_simulation = BooleanToggle(False)

# ----
# Roads
_8_lane_roads = Curve(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)
_2_lane_roads = Curve(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)
_4_lane_roads = Curve(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)
_6_lane_roads = Curve(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)

# ----
# Massing
massing = Geometry([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])

# ----
# Context
context = Geometry([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])

# ----
# Inputs
swatch = ColourSwatch(SwatchColor=RGB(217, 217, 217))
preview = CustomPreview(Geometry=context, Material=swatch)
panel_2 = Panel(model_units_for_correct_scaling)

# ----
# Split fo facade and floors/roofs
deconstruct_brep = DeconstructBrep(Brep=massing)  # -> Faces, Edges, Vertices
area = Area(Geometry=deconstruct_brep.Faces)  # -> Area, Centroid
deconstruct = Deconstruct(Point=area.Centroid)  # -> XComponent, YComponent, ZComponent
sort_list = SortList(Keys=deconstruct.ZComponent, ValuesValuesA=deconstruct_brep.Faces)  # -> Keys, ValuesValuesA
panel_3 = Panel("""-1
0""")
cull_index = CullIndex(List=sort_list.ValuesValuesA, Indices=panel_3, Wrap=True)
list_item = ListItem(List=sort_list.ValuesValuesA, Index=panel_3, Wrap=True)
floors_and_roofs = Data(list_item)
walls = Data(cull_index)

preview_2 = CustomPreview(Geometry=massing, Material=ColourSwatch(SwatchColor=RGBA(255, 255, 255, 10)))

# ----
# Analysis cluster
cluster = Cluster(
    units=model_units_for_correct_scaling,
    walls=walls,
    context=context,
    number_of_rays=number_of_rays_from_one_source,
    distance_between_noise_sources=distance_between_noise_sources,
    geometry_mesh=massing,
    horizontal_grid_size=grid_size,
    _2_lane_roads=_2_lane_roads,
    _4_lane_roads=_4_lane_roads,
    _6_lane_roads=_6_lane_roads,
    _8_lane_roads=_8_lane_roads,
    average_results=average_result_with_near_points,
    run=run_simulation)  # -> analysis_results_2, analysis_mesh_2, analysis_legend_2, facade_with_low_noise_2, facade_with_medium_noise_2, facade_with_high_noise_2

# ----
# Visualize noise sources
merge = Merge(Data1=_2_lane_roads, Data2=_4_lane_roads, Data3=_6_lane_roads, Data4=_8_lane_roads)
ptdividelen = DivideLength(Curve=merge, Distance=distance_between_noise_sources, RoundUp=False, RoundDn=False)
mesh_sphere = MeshSphere(Base=ptdividelen, Radius=2, UCount=10, VCount=20)
noise_sources = Mesh(mesh_sphere)

# ----
# Visualize road types
_2_lane_roads_2 = Curve(_2_lane_roads)
_4_lane_roads_2 = Curve(_4_lane_roads)
_8_lane_roads_2 = Curve(_8_lane_roads)
_6_lane_roads_2 = Curve(_6_lane_roads)
curve_middle = CurveMiddle(Curve=_2_lane_roads_2)
curve_middle_2 = CurveMiddle(Curve=_8_lane_roads_2)
curve_middle_3 = CurveMiddle(Curve=_6_lane_roads_2)
curve_middle_4 = CurveMiddle(Curve=_4_lane_roads_2)
define_text_dot = DefineTextDot(Text="2 lanes", Location=curve_middle, Font="Arial", Size=14)
define_text_dot_2 = DefineTextDot(Text="8 lanes", Location=curve_middle_2, Font="Arial", Size=14)
define_text_dot_3 = DefineTextDot(Text="6 lanes", Location=curve_middle_3, Font="Arial", Size=14)
define_text_dot_4 = DefineTextDot(Text="4 lanes", Location=curve_middle_4, Font="Arial", Size=14)

# ----
# Visualize results
panel_4 = Panel("-0.1")
face_normals = FaceNormals(Mesh=cluster.analysis_mesh_2)  # -> flatten(Centers), Normals
mesh_colours = MeshColours(Mesh=floors_and_roofs, Colours=ColourSwatch(SwatchColor=RGB(186, 186, 186)))
offmsh = OffsetMesh(Mesh=cluster.analysis_mesh_2, Distance=panel_4, BothSides=0, CreateSolid=True)
roofs_and_floors = Mesh(mesh_colours)
offset_mesh = Mesh(offmsh)
legend = Data(cluster.analysis_legend_2)

of_building_facade_with_medium_noise = Panel(cluster.facade_with_medium_noise_2)
of_building_facade_with_high_noise = Panel(cluster.facade_with_high_noise_2)
# Results
# Numerical results
of_building_facade_with_low_noise = Panel(cluster.facade_with_low_noise_2)

# ---- group: Text Tag
text_tag = TextTag(Location=flatten(face_normals.Centers), Text=flatten(cluster.analysis_results_2))

# ----
_4_lanes = Data(define_text_dot_4)
_6_lanes = Data(define_text_dot_3)
_2_lanes = Data(define_text_dot)
_8_lanes = Data(define_text_dot_2)

# ==== cluster Cluster
distance_between_noise_sources = ClusterInput()
horizontal_grid_size = ClusterInput()
geometry_mesh = ClusterInput()
number_of_rays = ClusterInput()
average_results = ClusterInput()
_2_lane_roads = ClusterInput()
_4_lane_roads = ClusterInput()
_6_lane_roads = ClusterInput()
_8_lane_roads = ClusterInput()
units = ClusterInput()
walls = ClusterInput()
context = ClusterInput()
run = ClusterInput()
distance_between_noise_sources_2 = Number(distance_between_noise_sources)
horizontal_grid_size_2 = Integer(horizontal_grid_size)
geometry_mesh_2 = Mesh(geometry_mesh)
number_of_rays_2 = Number(number_of_rays)
average_results_2 = Integer(average_results)
_2_lane_roads_2 = Data(_2_lane_roads)
_4_lane_roads_2 = Data(_4_lane_roads)
_6_lane_roads_2 = Data(_6_lane_roads)
_8_lane_roads_2 = Data(_8_lane_roads)
units_2 = Number(units)
walls_2 = Geometry(walls)
context_2 = Geometry(context)
run_2 = Boolean(run)
stream_filter = StreamFilter(Gate=units_2, Stream0="1000", Stream1="10", Stream2="1")
stream_filter_2 = StreamFilter(Gate=run_2, Stream1=walls_2)
stream_filter_3 = StreamFilter(Gate=run_2, Stream1=context_2)
stream_filter_4 = StreamFilter(Gate=run_2, Stream1=_2_lane_roads_2)
stream_filter_5 = StreamFilter(Gate=run_2, Stream1=_4_lane_roads_2)
stream_filter_6 = StreamFilter(Gate=run_2, Stream1=_6_lane_roads_2)
stream_filter_7 = StreamFilter(Gate=run_2, Stream1=_8_lane_roads_2)
stream_filter_8 = StreamFilter(Gate=run_2, Stream1=geometry_mesh_2)

# ----
# Clear tree (just in case)
clean_tree = CleanTree(RemoveNulls=True, RemoveInvalid=True, RemoveEmpty=invert(False), Tree=stream_filter_2)  # -> simplify(Tree)

# ----
# Rebuild mesh
panel = Panel("1")
panel_2 = Panel(horizontal_grid_size_2)
settings_custom = SettingsCustom(
    StitchSeams=True,
    SimplePlanes=False,
    Refine=True,
    MinCount=16,
    MaxCount=400,
    AspectRatio=20,
    MaxDistance=0,
    MaxAngle=20,
    MinEdge=panel,
    MaxEdge=panel_2)
mesh_brep = MeshBrep(Brep=clean_tree, Settings=settings_custom)
face_boundaries = FaceBoundaries(Mesh=mesh_brep)
boundary_surfaces = BoundarySurfaces(Edges=face_boundaries)

# ----
# 2 lane roads
create_noise_sources = CreateNoiseSources(
    scale=stream_filter,
    number_of_rays=number_of_rays_2,
    run=run_2,
    roads=stream_filter_4,
    desired_length=distance_between_noise_sources_2)  # -> noise_sphere_2, noise_point_2
organize_faces = OrganizeFaces(scale=stream_filter, surfaces=boundary_surfaces)  # -> organized_breps_offset_2, organized_breps_2
vector_hits = VectorHits(
    noise_point=create_noise_sources.noise_point_2,
    noise_sphere=create_noise_sources.noise_sphere_2,
    scale=stream_filter,
    geometry_mesh=stream_filter_8)  # -> points_2, vectors_2, hit_vectors_all_2, joined_geometry_mesh_2
hits_on_mesh = HitsOnMesh(
    panel_surfaces=boundary_surfaces,
    context=stream_filter_3,
    joined_geometry_mesh=vector_hits.joined_geometry_mesh_2,
    points=vector_hits.points_2,
    vectors=vector_hits.vectors_2,
    grid_size=horizontal_grid_size_2)  # -> points_hits_2, hit_vectors_on_geo_2, distance_2
hits_on_surfaces = HitsOnSurfaces(
    organized_breps=organize_faces.organized_breps_2,
    organized_breps_offset=organize_faces.organized_breps_offset_2,
    points_hits=hits_on_mesh.points_hits_2)  # -> hit_surfaces_2, rest_of_surfaces_2

# ----
# 6 lane roads
create_noise_sources_2 = CreateNoiseSources(
    scale=stream_filter,
    number_of_rays=number_of_rays_2,
    run=run_2,
    roads=stream_filter_6,
    desired_length=distance_between_noise_sources_2)  # -> noise_sphere_2, noise_point_2
organize_faces_2 = OrganizeFaces(scale=stream_filter, surfaces=boundary_surfaces)  # -> organized_breps_offset_2, organized_breps_2
vector_hits_2 = VectorHits(
    noise_point=create_noise_sources_2.noise_point_2,
    noise_sphere=create_noise_sources_2.noise_sphere_2,
    scale=stream_filter,
    geometry_mesh=stream_filter_8)  # -> points_2, vectors_2, hit_vectors_all_2, joined_geometry_mesh_2
hits_on_mesh_2 = HitsOnMesh(
    panel_surfaces=boundary_surfaces,
    context=stream_filter_3,
    joined_geometry_mesh=vector_hits_2.joined_geometry_mesh_2,
    points=vector_hits_2.points_2,
    vectors=vector_hits_2.vectors_2,
    grid_size=horizontal_grid_size_2)  # -> points_hits_2, hit_vectors_on_geo_2, distance_2
hits_on_surfaces_2 = HitsOnSurfaces(
    organized_breps=organize_faces_2.organized_breps_2,
    organized_breps_offset=organize_faces_2.organized_breps_offset_2,
    points_hits=hits_on_mesh_2.points_hits_2)  # -> hit_surfaces_2, rest_of_surfaces_2

# ----
# 4 lane roads
organize_faces_3 = OrganizeFaces(scale=stream_filter, surfaces=boundary_surfaces)  # -> organized_breps_offset_2, organized_breps_2
create_noise_sources_3 = CreateNoiseSources(
    scale=stream_filter,
    number_of_rays=number_of_rays_2,
    run=run_2,
    roads=stream_filter_5,
    desired_length=distance_between_noise_sources_2)  # -> noise_sphere_2, noise_point_2
vector_hits_3 = VectorHits(
    noise_point=create_noise_sources_3.noise_point_2,
    noise_sphere=create_noise_sources_3.noise_sphere_2,
    scale=stream_filter,
    geometry_mesh=stream_filter_8)  # -> points_2, vectors_2, hit_vectors_all_2, joined_geometry_mesh_2
hits_on_mesh_3 = HitsOnMesh(
    panel_surfaces=boundary_surfaces,
    context=stream_filter_3,
    joined_geometry_mesh=vector_hits_3.joined_geometry_mesh_2,
    points=vector_hits_3.points_2,
    vectors=vector_hits_3.vectors_2,
    grid_size=horizontal_grid_size_2)  # -> points_hits_2, hit_vectors_on_geo_2, distance_2
hits_on_surfaces_3 = HitsOnSurfaces(
    organized_breps=organize_faces_3.organized_breps_2,
    organized_breps_offset=organize_faces_3.organized_breps_offset_2,
    points_hits=hits_on_mesh_3.points_hits_2)  # -> hit_surfaces_2, rest_of_surfaces_2

# ----
# 8 lane roads
organize_faces_4 = OrganizeFaces(scale=stream_filter, surfaces=boundary_surfaces)  # -> organized_breps_offset_2, organized_breps_2
create_noise_sources_4 = CreateNoiseSources(
    scale=stream_filter,
    number_of_rays=number_of_rays_2,
    run=run_2,
    roads=stream_filter_7,
    desired_length=distance_between_noise_sources_2)  # -> noise_sphere_2, noise_point_2
vector_hits_4 = VectorHits(
    noise_point=create_noise_sources_4.noise_point_2,
    noise_sphere=create_noise_sources_4.noise_sphere_2,
    scale=stream_filter,
    geometry_mesh=stream_filter_8)  # -> points_2, vectors_2, hit_vectors_all_2, joined_geometry_mesh_2
hits_on_mesh_4 = HitsOnMesh(
    panel_surfaces=boundary_surfaces,
    context=stream_filter_3,
    joined_geometry_mesh=vector_hits_4.joined_geometry_mesh_2,
    points=vector_hits_4.points_2,
    vectors=vector_hits_4.vectors_2,
    grid_size=horizontal_grid_size_2)  # -> points_hits_2, hit_vectors_on_geo_2, distance_2
hits_on_surfaces_4 = HitsOnSurfaces(
    organized_breps=organize_faces_4.organized_breps_2,
    organized_breps_offset=organize_faces_4.organized_breps_offset_2,
    points_hits=hits_on_mesh_4.points_hits_2)  # -> hit_surfaces_2, rest_of_surfaces_2

# ----
# 4 lanes - rounded noise levels
db = Panel("71")
db_2 = Panel("67")
db_3 = Panel("60")
db_4 = Panel("57")
db_5 = Panel("54")
db_6 = Panel("52")
# 2 lanes - rounded noise levels
db_7 = Panel("62.5")
db_8 = Panel("57")
db_9 = Panel("52")
db_10 = Panel("50")
db_11 = Panel("47")
db_12 = Panel("42")
# 6 lanes - rounded noise levels
db_13 = Panel("76")
db_14 = Panel("73")
db_15 = Panel("66")
db_16 = Panel("63")
db_17 = Panel("60")
db_18 = Panel("57")
_120_180_m_noise = Number(db_3)
_180_240_m_noise = Number(db_4)
_240_300_m_noise = Number(db_5)
_300_360_m_noise = Number(db_6)
_60_120_m_noise = Number(db_2)
_0_60_m_noise = Number(db)

curve = Curve(hits_on_mesh.hit_vectors_on_geo_2)
curve_2 = Curve(vector_hits.hit_vectors_all_2)

curve_3 = Curve(vector_hits_2.hit_vectors_all_2)
curve_4 = Curve(hits_on_mesh_2.hit_vectors_on_geo_2)

curve_5 = Curve(vector_hits_3.hit_vectors_all_2)
curve_6 = Curve(hits_on_mesh_3.hit_vectors_on_geo_2)

_120_180_m_noise_2 = Number(db_9)
_180_240_m_noise_2 = Number(db_10)
_240_300_m_noise_2 = Number(db_11)
_300_360_m_noise_2 = Number(db_12)
_60_120_m_noise_2 = Number(db_8)
_120_180_m_noise_3 = Number(db_15)
_180_240_m_noise_3 = Number(db_16)
_240_300_m_noise_3 = Number(db_17)
_300_360_m_noise_3 = Number(db_18)
_0_60_m_noise_2 = Number(db_7)
_60_120_m_noise_3 = Number(db_14)
_0_60_m_noise_3 = Number(db_13)
# 8 lanes - rounded noise levels
db_19 = Panel("80")
db_20 = Panel("76")
db_21 = Panel("69")
db_22 = Panel("66")
db_23 = Panel("63")
db_24 = Panel("61")

curve_7 = Curve(hits_on_mesh_4.hit_vectors_on_geo_2)
curve_8 = Curve(vector_hits_4.hit_vectors_all_2)

_120_180_m_noise_4 = Number(db_21)
_180_240_m_noise_4 = Number(db_22)
_240_300_m_noise_4 = Number(db_23)
_300_360_m_noise_4 = Number(db_24)
_60_120_m_noise_4 = Number(db_20)
_0_60_m_noise_4 = Number(db_19)
noise_calculation = NoiseCalculation(
    _0_60_m_noise=_0_60_m_noise_2,
    _60_120_m_noise=_60_120_m_noise_2,
    _120_180_m_noise=_120_180_m_noise_2,
    _180_240_m_noise=_180_240_m_noise_2,
    _240_300_m_noise=_240_300_m_noise_2,
    _300_360_m_noise=_300_360_m_noise_2,
    distance=hits_on_mesh.distance_2,
    hit_surfaces=hits_on_surfaces.hit_surfaces_2,
    rest_of_surfaces=hits_on_surfaces.rest_of_surfaces_2)  # -> meshes_2, noise_values_2, location_points_2
noise_calculation_2 = NoiseCalculation(
    _0_60_m_noise=_0_60_m_noise,
    _60_120_m_noise=_60_120_m_noise,
    _120_180_m_noise=_120_180_m_noise,
    _180_240_m_noise=_180_240_m_noise,
    _240_300_m_noise=_240_300_m_noise,
    _300_360_m_noise=_300_360_m_noise,
    distance=hits_on_mesh_3.distance_2,
    hit_surfaces=hits_on_surfaces_3.hit_surfaces_2,
    rest_of_surfaces=hits_on_surfaces_3.rest_of_surfaces_2)  # -> meshes_2, noise_values_2, location_points_2
noise_calculation_3 = NoiseCalculation(
    _0_60_m_noise=_0_60_m_noise_3,
    _60_120_m_noise=_60_120_m_noise_3,
    _120_180_m_noise=_120_180_m_noise_3,
    _180_240_m_noise=_180_240_m_noise_3,
    _240_300_m_noise=_240_300_m_noise_3,
    _300_360_m_noise=_300_360_m_noise_3,
    distance=hits_on_mesh_2.distance_2,
    hit_surfaces=hits_on_surfaces_2.hit_surfaces_2,
    rest_of_surfaces=hits_on_surfaces_2.rest_of_surfaces_2)  # -> meshes_2, noise_values_2, location_points_2
noise_calculation_4 = NoiseCalculation(
    _0_60_m_noise=_0_60_m_noise_4,
    _60_120_m_noise=_60_120_m_noise_4,
    _120_180_m_noise=_120_180_m_noise_4,
    _180_240_m_noise=_180_240_m_noise_4,
    _240_300_m_noise=_240_300_m_noise_4,
    _300_360_m_noise=_300_360_m_noise_4,
    distance=hits_on_mesh_4.distance_2,
    hit_surfaces=hits_on_surfaces_4.hit_surfaces_2,
    rest_of_surfaces=hits_on_surfaces_4.rest_of_surfaces_2)  # -> meshes_2, noise_values_2, location_points_2
facade_mesh = FacadeMesh(
    meshes_2_lanes=noise_calculation.meshes_2,
    meshes_4_lanes=noise_calculation_2.meshes_2,
    meshes_6_lanes=noise_calculation_3.meshes_2,
    meshes_8_lanes=noise_calculation_4.meshes_2,
    location_points_2_lanes=noise_calculation.location_points_2,
    location_points_4_lanes=noise_calculation_2.location_points_2,
    location_points_6_lanes=noise_calculation_3.location_points_2,
    location_points_8_lanes=noise_calculation_4.location_points_2)  # -> facade_mesh_2, noise_location_points_2
merge_values = MergeValues(
    noise_location_points=facade_mesh.noise_location_points_2,
    noise_values_2_lanes=noise_calculation.noise_values_2,
    noise_values_4_lanes=noise_calculation_2.noise_values_2,
    noise_values_6_lanes=noise_calculation_3.noise_values_2,
    noise_values_8_lanes=noise_calculation_4.noise_values_2,
    location_points_2_lanes=noise_calculation.location_points_2,
    location_points_4_lanes=noise_calculation_2.location_points_2,
    location_points_6_lanes=noise_calculation_3.location_points_2,
    location_points_8_lanes=noise_calculation_4.location_points_2)
closest_points = ClosestPoints(Point=facade_mesh.noise_location_points_2, Cloud=facade_mesh.noise_location_points_2, Count=average_results_2)  # -> ClosestPoint, CPIndex, Distance
flatten_tree = FlattenTree(Tree=merge_values, Path="{0}")
list_item = ListItem(List=flatten_tree, Index=closest_points.CPIndex, Wrap=True)
average = Average(Input=list_item)
# Averaged values
# Direct values
averaged_values = Number(average)
direct_values = Number(merge_values)
db_25 = Panel("30")
db_26 = Panel("75")
high_noise_value = Integer(db_26)
low_noise_value = Integer(db_25)
clustering_results = ClusteringResults(run=run_2, averaged_values=averaged_values, low_noise_value=low_noise_value, high_noise_value=high_noise_value)  # -> facade_with_low_noise_2, facade_with_medium_noise_2, facade_with_high_noise_2
legend = Legend(averaged_values=averaged_values, low_noise_value=low_noise_value, high_noise_value=high_noise_value)
rounded_value = Number(expr("round(x,0)", averaged_values))
gradient = Gradient(
    LowerLimit=low_noise_value,
    UpperLimit=high_noise_value,
    Parameter=rounded_value,
    stops=[0: RGB(0, 191, 48), 0.797: RGB(255, 238, 184), 1: RGB(255, 0, 0)])
graft_tree = GraftTree(Tree=facade_mesh.facade_mesh_2, IncludeEmptyLists=True, IncludeNullItems=True)
mesh_colours = MeshColours(Mesh=simplify(graft_tree), Colours=simplify(gradient))
facade_with_medium_noise = Number(clustering_results.facade_with_medium_noise_2)
facade_with_high_noise = Number(clustering_results.facade_with_high_noise_2)
facade_with_low_noise = Number(clustering_results.facade_with_low_noise_2)
analysis_legend = Data(legend)
analysis_results = Number(rounded_value)
analysis_mesh = Mesh(mesh_colours)
analysis_mesh_2 = ClusterOutput(analysis_mesh)
analysis_results_2 = ClusterOutput(analysis_results)
analysis_legend_2 = ClusterOutput(analysis_legend)
facade_with_low_noise_2 = ClusterOutput(facade_with_low_noise)
facade_with_high_noise_2 = ClusterOutput(facade_with_high_noise)
facade_with_medium_noise_2 = ClusterOutput(facade_with_medium_noise)

# ==== cluster CreateNoiseSources
scale = ClusterInput()
number_of_rays = ClusterInput()
run = ClusterInput()
roads = ClusterInput()
desired_length = ClusterInput()
scale_2 = Integer(scale)
number_of_rays_2 = Integer(number_of_rays)
run_2 = Integer(run)
roads_2 = Curve(roads)
desired_length_2 = Number(desired_length)
base_size = Slider(2, range=0..1000)
stream_filter = StreamFilter(Gate=run_2, Stream1=roads_2)
divlength = DivideLength(Curve=stream_filter, Length=desired_length_2)  # -> Points, Tangents, Parameters
square_root = SquareRoot(Value=number_of_rays_2)
multiplication = Multiplication(A=base_size, B=scale_2)
flatten_tree = FlattenTree(Tree=divlength.Points, Path="{0}")
mesh_sphere = MeshSphere(Base=flatten_tree, Radius=multiplication, UCount=square_root, VCount=square_root)
noise_sphere = Mesh(mesh_sphere)
noise_point = Point(flatten_tree)
noise_sphere_2 = ClusterOutput(noise_sphere)
noise_point_2 = ClusterOutput(noise_point)

# ==== cluster OrganizeFaces
scale = ClusterInput()
surfaces = ClusterInput()
scale_2 = Integer(scale)
surfaces_2 = Brep(surfaces)
multiplication = Multiplication(A="1", B=scale_2)
negative = Negative(Value=multiplication)
offset_surface = OffsetSurface(Surface=surfaces_2, Distance=multiplication, BothSides=negative, CreateSolid=True)
flatten_tree = FlattenTree(Tree=offset_surface, Path="{0}")
flatten_tree_2 = FlattenTree(Tree=surfaces_2, Path="{0}")
graft_tree = GraftTree(Tree=flatten_tree, IncludeEmptyLists=True, IncludeNullItems=True)  # -> simplify(Tree)
graft_tree_2 = GraftTree(Tree=flatten_tree_2, IncludeEmptyLists=True, IncludeNullItems=True)  # -> simplify(Tree)
organized_breps_offset = Brep(graft_tree)
organized_breps = Brep(graft_tree_2)
organized_breps_offset_2 = ClusterOutput(organized_breps_offset)
organized_breps_2 = ClusterOutput(organized_breps)

# ==== cluster VectorHits
geometry_mesh = ClusterInput()
noise_sphere = ClusterInput()
noise_point = ClusterInput()
scale = ClusterInput()
geometry_mesh_2 = Mesh(geometry_mesh)
noise_sphere_2 = Mesh(noise_sphere)
noise_point_2 = Point(noise_point)
scale_2 = Integer(scale)
face_normals = FaceNormals(Mesh=noise_sphere_2)  # -> Centers, Normals
line = Line(StartPoint=graft(noise_point_2), EndPoint=face_normals.Centers)
deconstruct_vector = DeconstructVector(Vector=line)  # -> XComponent, YComponent, ZComponent
smaller_than = SmallerThan(FirstNumber=deconstruct_vector.ZComponent, SecondNumber="0")  # -> SmallerThan, OrEqualTo
arbitrary_large_number = Slider(1000, range=0..1000)
dispatch = Dispatch(List=line, DispatchPattern=smaller_than.SmallerThan)  # -> ListA, ListB
dispatch_2 = Dispatch(List=face_normals.Centers, DispatchPattern=smaller_than.SmallerThan)  # -> ListA, ListB
multiplication = Multiplication(A=arbitrary_large_number, B=scale_2)
amplitude = Amplitude(Vector=dispatch.ListB, Amplitude=multiplication)
mesh_join = MeshJoin(Meshes=geometry_mesh_2)
mesh_ray = MeshRay(Mesh=mesh_join, Point=dispatch_2.ListB, Direction=amplitude)  # -> Point, Hit
dispatch_3 = Dispatch(List=dispatch_2.ListB, DispatchPattern=mesh_ray.Hit)  # -> ListA, ListB
clean_tree = CleanTree(RemoveNulls=True, RemoveInvalid=True, RemoveEmpty=invert(False), Tree=mesh_ray.Point)
line_2 = Line(StartPoint=dispatch_3.ListA, EndPoint=clean_tree)
joined_geometry_mesh = Mesh(mesh_join)
hit_vectors_all = Curve(line_2)
vectors = Vector(amplitude)
points = Point(dispatch_2.ListB)
vectors_2 = ClusterOutput(vectors)
hit_vectors_all_2 = ClusterOutput(hit_vectors_all)
points_2 = ClusterOutput(points)
joined_geometry_mesh_2 = ClusterOutput(joined_geometry_mesh)

# ==== cluster HitsOnMesh
joined_geometry_mesh = ClusterInput()
panel_surfaces = ClusterInput()
grid_size = ClusterInput()
context = ClusterInput()
points = ClusterInput()
vectors = ClusterInput()
joined_geometry_mesh_2 = Mesh(joined_geometry_mesh)
panel_surfaces_2 = Surface(panel_surfaces)
grid_size_2 = Integer(grid_size)
context_2 = Geometry(context)
points_2 = Point(points)
vectors_2 = Vector(vectors)
merge = Merge(Data1=context_2, Data2=joined_geometry_mesh_2)
mesh_join = MeshJoin(Meshes=merge)
area = Area(Geometry=panel_surfaces_2)  # -> Area, Centroid
mesh_ray = MeshRay(Mesh=mesh_join, Point=points_2, Direction=vectors_2)  # -> Point, Hit
flatten_tree = FlattenTree(Tree=area.Centroid, Path="{0}")
closest_point = ClosestPoint(Point=mesh_ray.Point, Cloud=flatten_tree)  # -> ClosestPoint, CPIndex, Distance
smaller_than = SmallerThan(FirstNumber=closest_point.Distance, SecondNumber=grid_size_2)  # -> SmallerThan, OrEqualTo
dispatch = Dispatch(List=points_2, DispatchPattern=smaller_than.SmallerThan)  # -> ListA, ListB
dispatch_2 = Dispatch(List=mesh_ray.Point, DispatchPattern=smaller_than.SmallerThan)  # -> ListA, ListB
line = Line(StartPoint=dispatch_2.ListA, EndPoint=dispatch.ListA)
length = Length(Curve=line)
flatten_tree_2 = FlattenTree(Tree=length, Path="{0}")
hit_vectors_on_geo = Curve(line)
points_hits = Point(dispatch_2.ListA)
distance = Number(flatten_tree_2)
points_hits_2 = ClusterOutput(points_hits)
hit_vectors_on_geo_2 = ClusterOutput(hit_vectors_on_geo)
distance_2 = ClusterOutput(distance)

# ==== cluster HitsOnSurfaces
organized_breps_offset = ClusterInput()
organized_breps = ClusterInput()
points_hits = ClusterInput()
organized_breps_offset_2 = Mesh(organized_breps_offset)
organized_breps_2 = Brep(organized_breps)
points_hits_2 = Point(points_hits)
flatten_tree = FlattenTree(Tree=points_hits_2, Path="{0}")
mesh_inclusion = MeshInclusion(Mesh=organized_breps_offset_2, Point=flatten_tree, Strict=invert(Toggle(True)))
replace_nulls = ReplaceNulls(Items=mesh_inclusion, Replacements=0)  # -> Items, Count
mass_addition = MassAddition(Input=replace_nulls.Items)  # -> Result, PartialResults
larger_than = LargerThan(FirstNumber=mass_addition.Result, SecondNumber=0)  # -> LargerThan, OrEqualTo
dispatch = Dispatch(List=organized_breps_2, DispatchPattern=larger_than.LargerThan)  # -> ListA, ListB
flatten_tree_2 = FlattenTree(Tree=dispatch.ListA, Path="{0}")
flatten_tree_3 = FlattenTree(Tree=dispatch.ListB, Path="{0}")
rest_of_surfaces = Surface(flatten_tree_3)
hit_surfaces = Surface(flatten_tree_2)
hit_surfaces_2 = ClusterOutput(hit_surfaces)
rest_of_surfaces_2 = ClusterOutput(rest_of_surfaces)

# ==== cluster NoiseCalculation
_120_180_m_noise = ClusterInput()
_180_240_m_noise = ClusterInput()
_240_300_m_noise = ClusterInput()
_300_360_m_noise = ClusterInput()
rest_of_surfaces = ClusterInput()
_60_120_m_noise = ClusterInput()
_0_60_m_noise = ClusterInput()
hit_surfaces = ClusterInput()
distance = ClusterInput()
_120_180_m_noise_2 = Number(_120_180_m_noise)
_180_240_m_noise_2 = Number(_180_240_m_noise)
_240_300_m_noise_2 = Number(_240_300_m_noise)
_300_360_m_noise_2 = Number(_300_360_m_noise)
rest_of_surfaces_2 = Brep(rest_of_surfaces)
_60_120_m_noise_2 = Number(_60_120_m_noise)
_0_60_m_noise_2 = Number(_0_60_m_noise)
hit_surfaces_2 = Brep(hit_surfaces)
distance_2 = Number(distance)
m = Panel("180")
m_2 = Panel("360")
m_3 = Panel("120")
m_4 = Panel("240")
m_5 = Panel("300")
m_6 = Panel("60")
smaller_than = SmallerThan(FirstNumber=distance_2, SecondNumber=m_6)  # -> SmallerThan, OrEqualTo
smaller_than_2 = SmallerThan(FirstNumber=distance_2, SecondNumber=m_3)  # -> SmallerThan, OrEqualTo
larger_than = LargerThan(FirstNumber=distance_2, SecondNumber=m_6)  # -> LargerThan, OrEqualTo
smaller_than_3 = SmallerThan(FirstNumber=distance_2, SecondNumber=m)  # -> SmallerThan, OrEqualTo
larger_than_2 = LargerThan(FirstNumber=distance_2, SecondNumber=m_3)  # -> LargerThan, OrEqualTo
smaller_than_4 = SmallerThan(FirstNumber=distance_2, SecondNumber=m_4)  # -> SmallerThan, OrEqualTo
larger_than_3 = LargerThan(FirstNumber=distance_2, SecondNumber=m)  # -> LargerThan, OrEqualTo
smaller_than_5 = SmallerThan(FirstNumber=distance_2, SecondNumber=m_5)  # -> SmallerThan, OrEqualTo
larger_than_4 = LargerThan(FirstNumber=distance_2, SecondNumber=m_4)  # -> LargerThan, OrEqualTo
smaller_than_6 = SmallerThan(FirstNumber=distance_2, SecondNumber=m_2)  # -> SmallerThan, OrEqualTo
larger_than_5 = LargerThan(FirstNumber=distance_2, SecondNumber=m_5)  # -> LargerThan, OrEqualTo
simple_mesh = SimpleMesh(Brep=rest_of_surfaces_2)
gate_and = GateAnd(A=smaller_than_2.SmallerThan, B=larger_than.LargerThan)
gate_and_2 = GateAnd(A=smaller_than_3.SmallerThan, B=larger_than_2.LargerThan)
gate_and_3 = GateAnd(A=smaller_than_4.SmallerThan, B=larger_than_3.LargerThan)
gate_and_4 = GateAnd(A=smaller_than_5.SmallerThan, B=larger_than_4.LargerThan)
gate_and_5 = GateAnd(A=smaller_than_6.SmallerThan, B=larger_than_5.LargerThan)
mesh_colours = MeshColours(Mesh=simple_mesh, Colours="green")
dispatch = Dispatch(List=hit_surfaces_2, DispatchPattern=smaller_than.SmallerThan)  # -> ListA, ListB
dispatch_2 = Dispatch(List=hit_surfaces_2, DispatchPattern=gate_and)  # -> ListA, ListB
dispatch_3 = Dispatch(List=hit_surfaces_2, DispatchPattern=gate_and_2)  # -> ListA, ListB
dispatch_4 = Dispatch(List=hit_surfaces_2, DispatchPattern=gate_and_3)  # -> ListA, ListB
dispatch_5 = Dispatch(List=hit_surfaces_2, DispatchPattern=gate_and_4)  # -> ListA, ListB
dispatch_6 = Dispatch(List=hit_surfaces_2, DispatchPattern=gate_and_5)  # -> ListA, ListB
face_normals = FaceNormals(Mesh=mesh_colours)  # -> Centers, Normals
flatten_tree = FlattenTree(Tree=face_normals.Centers, Path="{0}")
area = Area(Geometry=dispatch.ListA)  # -> Area, Centroid
area_2 = Area(Geometry=dispatch_2.ListA)  # -> Area, Centroid
area_3 = Area(Geometry=dispatch_3.ListA)  # -> Area, Centroid
area_4 = Area(Geometry=dispatch_4.ListA)  # -> Area, Centroid
area_5 = Area(Geometry=dispatch_5.ListA)  # -> Area, Centroid
area_6 = Area(Geometry=dispatch_6.ListA)  # -> Area, Centroid
list_length = ListLength(List=flatten_tree)
minimal_value = Panel("30")
list_length_2 = ListLength(List=dispatch.ListA)
list_length_3 = ListLength(List=dispatch_2.ListA)
list_length_4 = ListLength(List=dispatch_3.ListA)
list_length_5 = ListLength(List=dispatch_4.ListA)
list_length_6 = ListLength(List=dispatch_5.ListA)
list_length_7 = ListLength(List=dispatch_6.ListA)
text_tag = TextTag(Location=area.Centroid, Text=_0_60_m_noise_2)
text_tag_2 = TextTag(Location=area_2.Centroid, Text=_60_120_m_noise_2)
text_tag_3 = TextTag(Location=area_3.Centroid, Text=_120_180_m_noise_2)
text_tag_4 = TextTag(Location=area_4.Centroid, Text=_180_240_m_noise_2)
text_tag_5 = TextTag(Location=area_5.Centroid, Text=_240_300_m_noise_2)
text_tag_6 = TextTag(Location=area_6.Centroid, Text=_300_360_m_noise_2)
text_tag_7 = TextTag(Location=face_normals.Centers, Text=minimal_value)
duplicate_data = DuplicateData(Data=minimal_value, Number=list_length, Order=True)
duplicate_data_2 = DuplicateData(Data=_0_60_m_noise_2, Number=list_length_2, Order=True)
duplicate_data_3 = DuplicateData(Data=_60_120_m_noise_2, Number=list_length_3, Order=True)
duplicate_data_4 = DuplicateData(Data=_120_180_m_noise_2, Number=list_length_4, Order=True)
duplicate_data_5 = DuplicateData(Data=_180_240_m_noise_2, Number=list_length_5, Order=True)
duplicate_data_6 = DuplicateData(Data=_240_300_m_noise_2, Number=list_length_6, Order=True)
duplicate_data_7 = DuplicateData(Data=_300_360_m_noise_2, Number=list_length_7, Order=True)
simple_mesh_2 = SimpleMesh(Brep=dispatch.ListA)
simple_mesh_3 = SimpleMesh(Brep=dispatch_2.ListA)
simple_mesh_4 = SimpleMesh(Brep=dispatch_3.ListA)
simple_mesh_5 = SimpleMesh(Brep=dispatch_4.ListA)
simple_mesh_6 = SimpleMesh(Brep=dispatch_5.ListA)
simple_mesh_7 = SimpleMesh(Brep=dispatch_6.ListA)
merge = Merge(
    Data1=flatten(simple_mesh_2),
    Data2=flatten(simple_mesh_3),
    Data3=flatten(simple_mesh_4),
    Data4=flatten(simple_mesh_5),
    Data5=flatten(simple_mesh_6),
    Data6=flatten(simple_mesh_7),
    Data7=flatten(simple_mesh))
merge_2 = Merge(
    Data1=flatten(duplicate_data_2),
    Data2=flatten(duplicate_data_3),
    Data3=flatten(duplicate_data_4),
    Data4=flatten(duplicate_data_5),
    Data5=flatten(duplicate_data_6),
    Data6=flatten(duplicate_data_7),
    Data7=flatten(duplicate_data))
merge_3 = Merge(
    Data1=flatten(area.Centroid),
    Data2=flatten(area_2.Centroid),
    Data3=flatten(area_3.Centroid),
    Data4=flatten(area_4.Centroid),
    Data5=flatten(area_5.Centroid),
    Data6=flatten(area_6.Centroid),
    Data7=flatten(face_normals.Centers))
location_points = Point(merge_3)
noise_values = Integer(merge_2)
meshes = Mesh(merge)
meshes_2 = ClusterOutput(meshes)
noise_values_2 = ClusterOutput(noise_values)
location_points_2 = ClusterOutput(location_points)

# ==== cluster FacadeMesh
location_points_2_lanes = ClusterInput()
location_points_4_lanes = ClusterInput()
location_points_6_lanes = ClusterInput()
location_points_8_lanes = ClusterInput()
meshes_2_lanes = ClusterInput()
meshes_6_lanes = ClusterInput()
meshes_8_lanes = ClusterInput()
meshes_4_lanes = ClusterInput()
location_points_2_lanes_2 = Point(location_points_2_lanes)
location_points_4_lanes_2 = Point(location_points_4_lanes)
location_points_6_lanes_2 = Point(location_points_6_lanes)
location_points_8_lanes_2 = Point(location_points_8_lanes)
meshes_2_lanes_2 = Mesh(meshes_2_lanes)
meshes_6_lanes_2 = Mesh(meshes_6_lanes)
meshes_8_lanes_2 = Mesh(meshes_8_lanes)
meshes_4_lanes_2 = Mesh(meshes_4_lanes)
entwine = Entwine(
    Branch00=meshes_2_lanes_2,
    Branch01=meshes_4_lanes_2,
    Branch02=meshes_6_lanes_2,
    Branch03=meshes_8_lanes_2,
    FlattenInputs=True)
list_item = ListItem(List=entwine, Index=0, Wrap=True)
null_item = NullItem(Item=list_item)  # -> NullFlags, InvalidFlags, Description
list_length = ListLength(List=entwine)
dispatch = Dispatch(List=simplify(list_length), DispatchPattern=simplify(null_item.NullFlags))  # -> ListA, ListB
clean_tree = CleanTree(RemoveNulls=True, RemoveInvalid=True, RemoveEmpty=invert(False), Tree=dispatch.ListB)
flatten_tree = FlattenTree(Tree=clean_tree, Path="{0}")
list_item_2 = ListItem(List=flatten_tree, Index=0, Wrap=True)
merge = Merge(Data1=meshes_2_lanes_2, Data2=meshes_4_lanes_2, Data3=meshes_6_lanes_2, Data4=meshes_8_lanes_2)
merge_2 = Merge(
    Data1=location_points_2_lanes_2,
    Data2=location_points_4_lanes_2,
    Data3=location_points_6_lanes_2,
    Data4=location_points_8_lanes_2)
partition_list = PartitionList(List=merge, Size=list_item_2)  # -> simplify(Chunks)
partition_list_2 = PartitionList(List=merge_2, Size=list_item_2)  # -> simplify(Chunks)
tree_branch = TreeBranch(Tree=partition_list, Path="{0}", MaintainPaths=True)
tree_branch_2 = TreeBranch(Tree=partition_list_2, Path="{0}", MaintainPaths=True)
noise_location_points = Point(tree_branch_2)
facade_mesh = Mesh(tree_branch)
facade_mesh_2 = ClusterOutput(facade_mesh)
noise_location_points_2 = ClusterOutput(noise_location_points)

# ==== cluster MergeValues
location_points_2_lanes = ClusterInput()
location_points_4_lanes = ClusterInput()
location_points_6_lanes = ClusterInput()
location_points_8_lanes = ClusterInput()
noise_location_points = ClusterInput()
noise_values_2_lanes = ClusterInput()
noise_values_4_lanes = ClusterInput()
noise_values_6_lanes = ClusterInput()
noise_values_8_lanes = ClusterInput()
location_points_2_lanes_2 = Point(location_points_2_lanes)
location_points_4_lanes_2 = Point(location_points_4_lanes)
location_points_6_lanes_2 = Point(location_points_6_lanes)
location_points_8_lanes_2 = Point(location_points_8_lanes)
noise_location_points_2 = Point(noise_location_points)
noise_values_2_lanes_2 = Integer(noise_values_2_lanes)
noise_values_4_lanes_2 = Integer(noise_values_4_lanes)
noise_values_6_lanes_2 = Integer(noise_values_6_lanes)
noise_values_8_lanes_2 = Integer(noise_values_8_lanes)
closest_point = ClosestPoint(Point=noise_location_points_2, Cloud=location_points_2_lanes_2)  # -> ClosestPoint, CPIndex, Distance
closest_point_2 = ClosestPoint(Point=noise_location_points_2, Cloud=location_points_4_lanes_2)  # -> ClosestPoint, CPIndex, Distance
closest_point_3 = ClosestPoint(Point=noise_location_points_2, Cloud=location_points_6_lanes_2)  # -> ClosestPoint, CPIndex, Distance
closest_point_4 = ClosestPoint(Point=noise_location_points_2, Cloud=location_points_8_lanes_2)  # -> ClosestPoint, CPIndex, Distance
list_item = ListItem(List=noise_values_2_lanes_2, Index=closest_point.CPIndex, Wrap=True)
list_item_2 = ListItem(List=noise_values_6_lanes_2, Index=closest_point_3.CPIndex, Wrap=True)
list_item_3 = ListItem(List=noise_values_4_lanes_2, Index=closest_point_2.CPIndex, Wrap=True)
list_item_4 = ListItem(List=noise_values_8_lanes_2, Index=closest_point_4.CPIndex, Wrap=True)
graft_tree = GraftTree(Tree=list_item, IncludeEmptyLists=True, IncludeNullItems=True)
graft_tree_2 = GraftTree(Tree=list_item_3, IncludeEmptyLists=True, IncludeNullItems=True)
graft_tree_3 = GraftTree(Tree=list_item_2, IncludeEmptyLists=True, IncludeNullItems=True)
graft_tree_4 = GraftTree(Tree=list_item_4, IncludeEmptyLists=True, IncludeNullItems=True)
merge = Merge(Data1=graft_tree, Data2=graft_tree_2, Data3=graft_tree_3, Data4=graft_tree_4)
sort_list = SortList(Keys=merge)  # -> Keys, ValuesValuesA
list_item_5 = ListItem(List=sort_list.Keys, Index=0, Wrap=True)  # -> Item1, Item
panel = Panel(list_item_5.Item1)
merged_noise_values = Data(list_item_5.Item1)
merged_noise_values_2 = ClusterOutput(merged_noise_values)

# ==== cluster Legend
averaged_values = ClusterInput()
high_noise_value = ClusterInput()
low_noise_value = ClusterInput()
averaged_values_2 = Number(averaged_values)
high_noise_value_2 = Integer(high_noise_value)
low_noise_value_2 = Integer(low_noise_value)
colrange = LBColorRange(index="12")  # -> colors; plug-in component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
legendpar = LBLegendParameters(
    min=low_noise_value_2,
    max=high_noise_value_2,
    seg_count="11",
    colors=colrange,
    num_decimals="0",
    seg_height="10",
    seg_width="10")  # -> leg_par; plug-in component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
createlegend = LBCreateLegend(values=flatten(averaged_values_2), title="dBA", legend_par=legendpar)  # -> mesh, title_obj, label_objs, label_text, colors; plug-in component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
merge = Merge(Data1=createlegend.mesh, Data2=createlegend.title_obj, Data3=createlegend.label_objs)  # -> flatten(Result)
bounding_box = BoundingBox(Content=merge, Plane=PlaneXY(0, 0, 0), UnionBox=True)  # -> Box, Box_2
area = Area(Geometry=bounding_box.Box)  # -> Area, Centroid
orient = Orient(Geometry=merge, Source=area.Centroid, Target=PlaneXY(0, 0, 0))  # -> Geometry, Transform
legend = Data(orient.Geometry)
legend_2 = ClusterOutput(legend)

# ==== cluster ClusteringResults
high_noise_value = ClusterInput()
averaged_values = ClusterInput()
low_noise_value = ClusterInput()
run = ClusterInput()
high_noise_value_2 = Integer(high_noise_value)
averaged_values_2 = Number(averaged_values)
low_noise_value_2 = Integer(low_noise_value)
run_2 = Boolean(run)
flatten_tree = FlattenTree(Tree=averaged_values_2, Path="{0}")
smaller_than = SmallerThan(FirstNumber=flatten_tree, SecondNumber=low_noise_value_2)  # -> SmallerThan, OrEqualTo
larger_than = LargerThan(FirstNumber=flatten_tree, SecondNumber=low_noise_value_2)  # -> LargerThan, OrEqualTo
smaller_than_2 = SmallerThan(FirstNumber=flatten_tree, SecondNumber=high_noise_value_2)  # -> SmallerThan, OrEqualTo
larger_than_2 = LargerThan(FirstNumber=flatten_tree, SecondNumber=high_noise_value_2)  # -> LargerThan, OrEqualTo
equality = Equality(FirstNumber=flatten_tree, SecondNumber=low_noise_value_2)  # -> Equality, Inequality
list_length = ListLength(List=flatten_tree)
gate_and = GateAnd(A=larger_than.LargerThan, B=smaller_than_2.SmallerThan)
number = Number(smaller_than.OrEqualTo)
number_2 = Number(gate_and)
number_3 = Number(larger_than_2.LargerThan)
mass_addition = MassAddition(Input=number)  # -> Result, PartialResults
mass_addition_2 = MassAddition(Input=number_2)  # -> Result, PartialResults
mass_addition_3 = MassAddition(Input=number_3)  # -> Result, PartialResults
division = Division(A=mass_addition.Result, B=list_length)
division_2 = Division(A=mass_addition_2.Result, B=list_length)
division_3 = Division(A=mass_addition_3.Result, B=list_length)
multiplication = Multiplication(A=division, B="100")
multiplication_2 = Multiplication(A=division_2, B="100")
multiplication_3 = Multiplication(A=division_3, B="100")
number_4 = Number(expr("round(x,1)", multiplication))
number_5 = Number(expr("round(x,1)", multiplication_2))
number_6 = Number(expr("round(x,1)", multiplication_3))
stream_filter = StreamFilter(Gate=run_2, Stream1=number_4)
stream_filter_2 = StreamFilter(Gate=run_2, Stream1=number_5)
stream_filter_3 = StreamFilter(Gate=run_2, Stream1=number_6)
facade_with_medium_noise = Data(stream_filter_2)
facade_with_high_noise = Data(stream_filter_3)
facade_with_low_noise = Data(stream_filter)
facade_with_low_noise_2 = ClusterOutput(facade_with_low_noise)
facade_with_high_noise_2 = ClusterOutput(facade_with_high_noise)
facade_with_medium_noise_2 = ClusterOutput(facade_with_medium_noise)
